# Grasshopper definition concrete_sample.gh (Grasshopper 1.0.7)
# plug-ins: Robots, Pufferfish, Human, Heteroptera

export_code = Button()
start_point = Slider(0.8, range=0..1)
number_slider = Slider(1, range=0..1)
program_calculations_takes_long_time_set = ValueList({"0", "GO!": 1}, selected="GO!")  # "Program calculations (takes long time set everyting before this step)"
end_point = ValueList({"++200": 0, "+-200": 1, "-+200": 2, "--200": 3}, selected="++200")
seam_length = Slider(50, range=0..1000)
geo = Geometry(<brep referenced from the Rhino model>)

# ---- group: Are you printing open curve?
list = ValueList({"No": 0, "Yes": 1}, selected="No")

# ----
layer_height = Slider(12, range=0..100)
rec = DataRecorder(export_code, DataLimit=-10, RecordData=True)
sortbytype = SortObjectsByType(RhinoObjects=geo)  # -> Points, Curves, Surfaces, Breps, Meshes, TextObjects, HatchObjects, LightObjects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
list_2 = ValueList({"Nozzle left": 0, "Nozzle right": 1}, selected="Nozzle right")
nozzle_height = ValueList({"350": 0, "500": 1, "700": 2, "900": 3, "1150": 4}, selected="350")
robot_orientation = ValueList({"0", "180": 1}, selected="180")
nozzle_distance_from_robot_dont_change = ValueList({"405": 0, "455": 1, "505": 2}, selected="455")
item = ListItem(List=sortbytype.TypeMap, Index=0, Wrap=True)
gate = StreamGate(Stream=geo, Gate=item)  # -> Target0, Target1, Target2, Target3, Target4
lng = ListLength(List=gate.Target1)
contour = Contour(Shape=[gate.Target3, gate.Target4, gate.Target2], Point=Point(0, 0, 0), Direction=Vector(0, 0, 1), Distance=layer_height)  # -> simplify(Contours)
smaller = SmallerThan(FirstNumber=lng, SecondNumber="1")  # -> SmallerThan, OrEqualTo
dispatch = Dispatch(List=gate.Target1, DispatchPattern=smaller.OrEqualTo)  # -> ListA, ListB
brep = Brep()

# ---- group: wavy pattern
brep_2 = Brep(<brep referenced from the Rhino model>)
number_slider_2 = Slider(100, range=0..1000)
contour_2 = Contour(Shape=brep_2, Point=Point(0, 0, 0), Direction=Vector(0, 0, 1), Distance=Slider(12, range=0..100))
divide = DivideCurve(Curve=contour_2, Count=number_slider_2, Kinks=False)  # -> Points, Tangents, Parameters
culln = CullNth(List=divide.Points, CullFrequency=number_slider_2)
intcrv = Interpolate(Vertices=flatten(culln), Degree=3, Periodic=False, KnotStyle=1)  # -> Curve, Length, Domain
divide_length = DivideLength(Curve=intcrv.Curve, Length=Slider(30, range=0..100))  # -> Points, Tangents, Parameters
horizontal_frame = HorizontalFrame(Curve=intcrv.Curve, Parameter=divide_length.Parameters)
deplane = DeconstructPlane(Plane=simplify(horizontal_frame))  # -> Origin, XAxis, YAxis, ZAxis
neg = Negative(Value=Slider(30, range=0..100))
line = LineSDL(Start=divide_length.Points, Direction=deplane.YAxis, Length=neg)
end = EndPoints(Curve=line)  # -> Start, End
cull_pattern = CullPattern(List=divide_length.Points, CullPattern=[False, True])
cull_pattern_2 = CullPattern(List=end.End, CullPattern=invert([False, True]))
shift_list = ShiftList(List=cull_pattern_2, Shift=Slider(1, range=0..1), Wrap=True)
list_length = ListLength(List=shift_list)
cull_nth = CullNth(List=shift_list, CullFrequency=list_length)
weave = Weave(Pattern=[0, 1], Stream0=cull_pattern, Stream1=cull_nth, NullGaps=False)
polyline = PolyLine(Vertices=weave, Closed=False)
intcrv_2 = Interpolate(Vertices=weave, Degree=3, Periodic=False, KnotStyle=1)  # -> Curve, Length, Domain

# ----
contour_3 = Contour(Shape=brep, Point=Point(0, 0, 0), Direction=Vector(0, 0, 1), Distance=Slider(12, range=0..100))
number_slider_3 = Slider(100, range=0..1000)
max_print_height = Slider(12, range=0..100)

# ---- group: Print object
brep_3 = Brep(<brep referenced from the Rhino model>)

# ---- group: Top Surface
srf = Surface(<surface referenced from the Rhino model>)

# ---- group: Bottom Surface
srf_2 = Surface(<surface referenced from the Rhino model>)

# ----
divide_2 = DivideCurve(Curve=contour_3, Count=number_slider_3, Kinks=False)  # -> Points, Tangents, Parameters
culln_2 = CullNth(List=divide_2.Points, CullFrequency=number_slider_3)
bbox = BoundingBox(Content=brep_3, Plane=PlaneXY(0, 0, 0))  # -> Box, Box_2
intcrv_3 = Interpolate(Vertices=flatten(culln_2), Degree=3, Periodic=False, KnotStyle=1)  # -> Curve, Length, Domain
debrep = DeconstructBrep(Brep=bbox.Box)  # -> Faces, Edges, Vertices
item_2 = ListItem(List=debrep.Edges, Index=Slider(8, range=0..10), Wrap=True)
len = Length(Curve=item_2)
division = Division(A=len, B=max_print_height)
round = Round(Number=division)  # -> Nearest, Floor, Ceiling
divide_length_2 = DivideLength(Curve=intcrv_3.Curve, Length=Slider(38, range=0..100))  # -> Points, Tangents, Parameters
range = Range(Domain=Domain(0, 1), Steps=round.Nearest)
geo_2 = Geometry(<curve referenced from the Rhino model>)
geo_3 = Geometry(<brep referenced from the Rhino model>)
twn2srfs = TweenTwoSurfaces(SurfaceA=srf_2, SurfaceB=srf, Factor=range, Refit=0, PointSample=0)
horizontal_frame_2 = HorizontalFrame(Curve=intcrv_3.Curve, Parameter=divide_length_2.Parameters)
pull = PullPoint(Point=divide_length_2.Points, Geometry=flatten(geo_2), ClosestOnly=True)  # -> ClosestPoint, Distance
pull_2 = PullPoint(Point=divide_length_2.Points, Geometry=flatten(geo_3), ClosestOnly=True)  # -> ClosestPoint, Distance
bbx = BrepBrep(BrepA=brep_3, BrepB=twn2srfs)  # -> Curves, Points
deplane_2 = DeconstructPlane(Plane=simplify(horizontal_frame_2))  # -> Origin, XAxis, YAxis, ZAxis
crv = Curve(flatten(bbx.Curves))
smaller_2 = SmallerThan(FirstNumber=pull.Distance, SecondNumber=Slider(96, range=0..1000))  # -> SmallerThan, OrEqualTo
smaller_3 = SmallerThan(FirstNumber=pull_2.Distance, SecondNumber=Slider(61, range=0..1000))  # -> SmallerThan, OrEqualTo

# ---- group: Remove first layer
split = SplitTree(Masks=flatten("{0}"))  # -> Positive, Negative
crv_2 = Curve(split.Positive)
crv_3 = Curve(split.Negative)

# ----
dispatch_2 = Dispatch(List=pull.Distance, DispatchPattern=smaller_2.SmallerThan)  # -> ListA, ListB
dispatch_3 = Dispatch(List=pull_2.Distance, DispatchPattern=smaller_3.SmallerThan)  # -> ListA, ListB
single_curve = Curve(dispatch.ListA)
dom = ConstructDomain(DomainStart=Slider(51, range=0..100), DomainEnd=Slider(0, range=0..1000))
dom_2 = ConstructDomain(DomainStart=Slider(15, range=0..100), DomainEnd=Slider(0, range=0..1000))
lng_2 = ListLength(List=dispatch_2.ListB)
bnd = Bounds(Numbers=dispatch_2.ListA)
lng_3 = ListLength(List=dispatch_3.ListB)
bnd_2 = Bounds(Numbers=dispatch_3.ListA)
remap = RemapNumbers(Value=dispatch_2.ListA, Source=bnd, Target=dom)  # -> Mapped, Clipped
repeat = RepeatData(Data="0", Length=lng_2)
remap_2 = RemapNumbers(Value=dispatch_3.ListA, Source=bnd_2, Target=dom_2)  # -> Mapped, Clipped
repeat_2 = RepeatData(Data="0", Length=lng_3)
weave_2 = Weave(Pattern=smaller_2.SmallerThan, Stream0=repeat, Stream1=remap.Mapped, NullGaps=False)
weave_3 = Weave(Pattern=smaller_3.SmallerThan, Stream0=repeat_2, Stream1=remap_2.Mapped, NullGaps=False)
max = Maximum(A=weave_2, B=weave_3)
neg_2 = Negative(Value=max)
neg_3 = Negative(Value=weave_3)
neg_4 = Negative(Value=weave_2)
line_2 = LineSDL(Start=divide_length_2.Points, Direction=deplane_2.YAxis, Length=neg_2)
line_3 = LineSDL(Start=divide_length_2.Points, Direction=deplane_2.YAxis, Length=neg_3)
end_2 = EndPoints(Curve=line_2)  # -> Start, End
line_4 = LineSDL(Start=divide_length_2.Points, Direction=deplane_2.YAxis, Length=neg_4)
cull_pattern_3 = CullPattern(List=end_2.End, CullPattern=invert([False, True]))
cull_pattern_4 = CullPattern(List=divide_length_2.Points, CullPattern=[False, True])
shift_list_2 = ShiftList(List=cull_pattern_3, Shift=Slider(1, range=0..1), Wrap=True)
list_length_2 = ListLength(List=shift_list_2)
cull_nth_2 = CullNth(List=shift_list_2, CullFrequency=list_length_2)
weave_4 = Weave(Pattern=[0, 1], Stream0=cull_pattern_4, Stream1=cull_nth_2, NullGaps=False)
polyline_2 = PolyLine(Vertices=weave_4, Closed=False)
intcrv_4 = Interpolate(Vertices=weave_4, Degree=3, Periodic=False, KnotStyle=1)  # -> Curve, Length, Domain

# ---- group: Speed modifications / Specify in Rhino
srf_3 = Surface(<surface referenced from the Rhino model>)

# ---- group: Speed modifications
pln = Plane()
deplane_3 = DeconstructPlane(Plane=pln)  # -> Origin, XAxis, YAxis, ZAxis
brep_cp = BrepClosestPoint(Point=deplane_3.Origin, Brep=flatten(srf_3))  # -> Point, Normal, Distance
smaller_4 = SmallerThan(FirstNumber=brep_cp.Distance, SecondNumber=Slider(300, range=0..1000))  # -> SmallerThan, OrEqualTo
dispatch_4 = Dispatch(List=pln, DispatchPattern=smaller_4.SmallerThan)  # -> ListA, ListB
pln_2 = Plane(dispatch_4.ListB)
pln_3 = Plane(dispatch_4.ListA)
deplane_4 = DeconstructPlane(Plane=pln_3)  # -> Origin, XAxis, YAxis, ZAxis
brep_cp_2 = BrepClosestPoint(Point=deplane_4.Origin, Brep=srf_3)  # -> Point, Normal, Distance
bnd_3 = Bounds(Numbers=brep_cp_2.Distance)
dom_3 = ConstructDomain(DomainStart=Slider(300, range=-30..1000), DomainEnd=Slider(400, range=0..1000))
remap_3 = RemapNumbers(Value=brep_cp_2.Distance, Source=bnd_3, Target=dom_3)  # -> Mapped, Clipped
list_3 = ValueList({"Joint", "Linear"}, selected="Linear")
list_4 = ValueList({"Joint", "Linear"}, selected="Linear")
target = CreateTarget(Plane=pln_2, Motion=list_3, Speed="400", Zone="15", IsCartesian=True)  # -> flatten(Target)
target_2 = CreateTarget(Plane=pln_3, Motion=list_4, Speed=remap_3.Mapped, Zone="15", IsCartesian=True)  # -> flatten(Target)
weave_5 = Weave(Pattern=smaller_4.SmallerThan, Stream0=target, Stream1=target_2, NullGaps=False)

# ---- group: Nozzle rotation when close to other objcets
pln_4 = Plane()
srf_4 = Surface(<surface referenced from the Rhino model>)
debrep_2 = DeconstructBrep(Brep=srf_4)  # -> Faces, Edges, Vertices
deplane_5 = DeconstructPlane(Plane=pln_4)  # -> Origin, XAxis, YAxis, ZAxis
item_3 = ListItem(List=debrep_2.Edges, Index=0, Wrap=True)
brep_cp_3 = BrepClosestPoint(Point=deplane_5.Origin, Brep=srf_4)  # -> Point, Normal, Distance
vec = Vector(item_3)
smaller_5 = SmallerThan(FirstNumber=brep_cp_3.Distance, SecondNumber=Slider(300, range=0..1000))  # -> SmallerThan, OrEqualTo
dispatch_5 = Dispatch(List=pln_4, DispatchPattern=smaller_5.SmallerThan)  # -> ListA, ListB
pln_5 = Plane(dispatch_5.ListA)
pln_6 = Plane(dispatch_5.ListB)
deplane_6 = DeconstructPlane(Plane=pln_5)  # -> Origin, XAxis, YAxis, ZAxis
brep_cp_4 = BrepClosestPoint(Point=deplane_6.Origin, Brep=srf_4)  # -> Point, Normal, Distance
bnd_4 = Bounds(Numbers=brep_cp_4.Distance)
dom_4 = ConstructDomain(DomainStart=Slider(-15, range=-30..1000), DomainEnd=Slider(0, range=0..1000))
line_5 = LineSDL(Start=pln_5, Direction=vec, Length=1)
remap_4 = RemapNumbers(Value=brep_cp_4.Distance, Source=bnd_4, Target=dom_4)  # -> Mapped, Clipped
rotax = RotateAxis(Geometry=pln_5, Angle=degrees(remap_4.Mapped), Axis=line_5)  # -> Geometry, Transform
weave_6 = Weave(Pattern=smaller_5.SmallerThan, Stream0=pln_6, Stream1=rotax.Geometry, NullGaps=False)
pln_7 = Plane(weave_6)

# ----
pipe = Pipe(Curve=intcrv_4.Curve, Radius=Slider(10, range=0..100), Caps=0)

# ---- group: Tool Data
original_x_350 = Slider(500, range=0..2000)
original_x_350_2 = Slider(900, range=0..2000)
original_x_350_3 = Slider(1150, range=0..2000)
original_x_350_4 = Slider(350, range=0..2000)
original_x_350_5 = Slider(700, range=0..2000)
original_z_405 = Slider(405, range=0..1000)
original_z_405_2 = Slider(455, range=0..1000)
original_z_405_3 = Slider(505, range=0..1000)
filter = StreamFilter(
    Gate=nozzle_height,
    Stream0=original_x_350_4,
    Stream1=original_x_350,
    Stream2=original_x_350_5,
    Stream3=original_x_350_2,
    Stream4=original_x_350_3)
filter_2 = StreamFilter(Gate=nozzle_distance_from_robot_dont_change, Stream0=original_z_405, Stream1=original_z_405_2, Stream2=original_z_405_3)
pt = ConstructPoint(XCoordinate=0, YCoordinate=0, ZCoordinate=0)
pt_2 = ConstructPoint(XCoordinate=filter, YCoordinate=0, ZCoordinate=filter_2)
pt_3 = ConstructPoint(XCoordinate=0, YCoordinate=0, ZCoordinate=filter_2)
yz = YZPlane(Origin=pt_2)
Y = UnitY(Factor=1)
pline = PolyLine(Vertices=[pt_2, pt_3, pt], Closed=False)
rot3d = Rotate3D(Geometry=yz, Angle=degrees(180), Center=yz, Axis=Y)  # -> Geometry, Transform
pipe_2 = Pipe(Curve=pline, Radius=Slider(35, range=0..100), Caps=0)
tool = CreateTool(Name="ConcreteNozzle", TCP=rot3d.Geometry, Weight=0, Mesh=pipe_2)  # -> Tool, TCP

# ---- group: Angle of nozzle / Robot reach
dom_5 = ConstructDomain(DomainStart=Slider(1000, range=0..5000), DomainEnd=Slider(3200, range=0..5000))

# ---- group: Numbering
int = Integer(0)
lng_4 = ListLength(List=flatten([rec, int]))  # -> expr("Max(0, (x-1)\2)", Length)
smaller_6 = SmallerThan(FirstNumber=lng_4, SecondNumber=Slider(10, range=0..10))  # -> SmallerThan, OrEqualTo
dispatch_6 = Dispatch(List=lng_4, DispatchPattern=smaller_6.SmallerThan)  # -> ListA, ListB
concat = Concatenate(FragmentA="0", FragmentB=dispatch_6.ListA)
dispatch_7 = Dispatch(List=concat, DispatchPattern=smaller_6.SmallerThan)  # -> ListA, ListB
panel = Panel([dispatch_7.ListA, dispatch_6.ListB])

# ---- group: Robot rotation
pl = ConstructPlane(Origin=Point(0, 0, 0), XAxis=Vector(1, 0, 0), YAxis=Vector(0, 1, 0))
pl_2 = ConstructPlane(Origin=Point(0, 0, 0), XAxis=Vector(1, 0, 0), YAxis=Vector(0, 1, 0))
rotate = Rotate(Geometry=pl, Angle=degrees(Slider(180, range=0..1000)), Plane=PlaneXY(0, 0, 0))  # -> Geometry, Transform
filter_3 = StreamFilter(Gate=robot_orientation, Stream0=pl_2, Stream1=rotate.Geometry)

# ----
list_5 = ValueList({"Joint", "Linear"}, selected="Linear")
list_6 = RobotsLibrary(
    {"AA-KR60", "AA-KR30", "AA-KR60_KR30", "AARCH IRB120", "AARCH IRB6620", "Bartlett-IRB120", "Bartlett-IRB1600", "Bartlett-KR6", "Bartlett-KR60", "Bartlett-UR10"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}, selected="EXArchitects-IRB6700",
    Type=0)
load_robot = LoadRobotSystem(Name=list_6, Base=filter_3)
file_name = Panel("Jirka")
objdet = ObjectDetails(Object=geo)  # -> Referenced, Available, Name, Layer, Colour, Guid

# ---- group: Sort curves
crv_4 = Curve(dispatch.ListB)

# ----
center = Center(Geometry=crv_4)  # -> Center, Dimension

# ---- group: Sort curves (continued)
pdecon = Deconstruct(Point=center.Center)  # -> XComponent, YComponent, ZComponent
sort = SortList(Keys=pdecon.ZComponent, ValuesA=crv_4)  # -> Keys, ValuesA

# ---- group: Remove duplicated curves
curvepoint = PointOnCurve(sort.ValuesA, parameter=0.42)
cullpt = CullDuplicates(Points=curvepoint, Tolerance=0.1, CullMode=1)  # -> Points, Indices, Valence
item_4 = ListItem(List=sort.ValuesA, Index=cullpt.Indices, Wrap=True)

# ---- group: Multiple Curves
single_curve_2 = Curve(graft(item_4))

# ----
clean = CleanTree(RemoveNulls=True, RemoveInvalid=True, RemoveEmpty="true", Tree=[contour, single_curve_2])  # -> simplify(Tree)
gate_2 = StreamGate(Stream=clean, Gate=list)  # -> Target0, Target1

# ---- group: Open curve control
# Open curves
crv_5 = Curve(gate_2.Target1)
cls = Closed(Curve=crv_5)  # -> Closed, Periodic
dispatch_8 = Dispatch(List=crv_5, DispatchPattern=cls.Closed)  # -> ListA, ListB
geo_4 = Geometry(dispatch_8.ListB)
geo_5 = Geometry(dispatch_8.ListA)

# ---- group: Open curves Detector/Connector
# Open curves
geo_6 = Geometry(graft(geo_4))
split_2 = SplitTree(Data=simplify(geo_6), Masks=flatten("{0,2,...}"))  # -> Positive, Negative
flip = FlipCurve(Curve=split_2.Negative)  # -> Curve, Flag
merge = Merge(Data1=split_2.Positive, Data2=flip.Curve)  # -> flatten(Result)
connect = ConnectCurves(Curves=merge, Continuity=2, Close="false", Bulge=Slider(1, range=0..10))

# ---- group: Close multiple gaps on one contour
prune = PruneTree(Tree=[gate_2.Target0, geo_5], Minimum="2", Maximum=0)
prune_2 = PruneTree(Tree=[gate_2.Target0, geo_5], Minimum=0, Maximum="1")
end_3 = EndPoints(Curve=prune)  # -> Start, End
join = JoinCurves(Curves=prune_2, Preserve=False)
shift = ShiftList(List=end_3.End, Shift=1, Wrap=True)
clscrv = CloseCurve(Curve=join, CloseType=0, Bulge=0.5, Tolerance=0)  # -> Closed, R
ln = Line(StartPoint=end_3.Start, EndPoint=shift)
merge_2 = Merge(Data1=simplify(ln), Data2=simplify(prune), Data3=simplify(clscrv.Closed))
join_2 = JoinCurves(Curves=merge_2, Preserve=False)  # -> simplify(Curves)

# ----
cls_2 = Closed(Curve=join)  # -> Closed, Periodic
panel_2 = Panel(cls_2.Closed)

# ---- group: Curve align
item_5 = ListItem(List=flatten(join_2), Index=0, Wrap=True)
flip_2 = FlipCurve(Curve=join_2, Guide=item_5)  # -> Curve, Flag

# ---- group: Alternative start point
surface = Surface(<surface referenced from the Rhino model>)
surface_curve = SurfaceCurve(Surface=surface, Curve=flip_2.Curve)  # -> Curves, Points, UVPoints, Normals, Parameters, Tangents
seam = Seam(Curve=flip_2.Curve, Seam=surface_curve.Parameters)

# ---- group: Strt Point
item_6 = ListItem(List=flatten(flip_2.Curve), Index=0, Wrap=True)
eval = EvaluateCurve(Curve=reparameterize(item_6), Parameter=start_point)  # -> Point, Tangent, Angle
alicrvseams = AlignCurveSeams(Curves=flip_2.Curve, Guide=eval.Point, Snap=False, Iterative=True)  # -> Aligned, Points, R

# ----
divlength = DivideLength(Curve=seam, Length="10")  # -> Points, Tangents, Parameters
split_3 = SplitList(List=divlength.Points, Index="2")  # -> ListA, ListB
pt_4 = Point(flatten(split_3.ListB))
pt_5 = Point(split_3.ListA)
intcrv_5 = Interpolate(Vertices=pt_4, Degree=3, Periodic=False, KnotStyle=1)  # -> Curve, Length, Domain

# ---- group: Curve seam
division_2 = Division(A=seam_length, B="2")
circle = CircleCNR(Center=alicrvseams.Points, Normal=Vector(0, 0, 1), Radius=division_2)
trim = TrimWithRegions(Curve=alicrvseams.Aligned, Regions=circle)  # -> Inside, simplify(Outside)
crv_6 = Curve(trim.Outside)
end_4 = EndPoints(Curve=crv_6)  # -> Start, End
item_7 = ListItem(List=sortbytype.TypeMap, Index=0, Wrap=True)
shift_2 = ShiftList(List=flatten(end_4.Start), Shift=1, Wrap="false")
ln_2 = Line(StartPoint=flatten(end_4.End), EndPoint=shift_2)
gate_3 = StreamGate(Stream=trim.Inside, Gate=item_7)  # -> Target0, Target1, Target2, Target3
item_8 = ListItem(List=ln_2, Index="-1", Wrap=True)
loft = Loft(
    Curves=flatten(gate_3.Target1),
    Options={Adjust=False, Closed=False, LoftEnds=0, LoftSimp=0, LoftType=0, Rebuild=10, Refit=0.01})
end_5 = EndPoints(Curve=item_8)  # -> Start, End
lng_5 = ListLength(List=ln_2)  # -> expr("x-1", Length)
midpt = CurveMiddle(Curve=item_8)
filter_4 = StreamFilter(Gate=item_7, Stream1=loft, Stream3=geo)
ln_3 = Line(StartPoint=end_5.Start, EndPoint=midpt)
replace = ReplaceItems(List=ln_2, Item=ln_3, Indices=lng_5, Wrap=False)
seam_precision = Slider(10, range=0..10)
item_9 = ListItem(List=replace, Index=0, Wrap=True)
len_2 = Length(Curve=item_9)
division_3 = Division(A=len_2, B=seam_precision)
divide_3 = DivideCurve(Curve=replace, Count=division_3, Kinks=False)  # -> Points, Tangents, Parameters

# ---- group: Curve seam / Seam reflect to brep
brep_cp_5 = BrepClosestPoint(Point=divide_3.Points, Brep=filter_4)  # -> Point, Normal, Distance

# ---- group: Curve seam (continued)
intcrv_6 = Interpolate(Vertices=brep_cp_5.Point, Degree=3, Periodic=False, KnotStyle=1)  # -> simplify(Curve), Length, Domain
merge_3 = Merge(Data1=crv_6, Data2=intcrv_6.Curve)
join_3 = JoinCurves(Curves=flatten(merge_3), Preserve=False)

# ----
relay = Relay([single_curve, connect, join_3])

# ---- group: Checkstart/endpoint
end_6 = EndPoints(Curve=relay)  # -> Start, End
pt_6 = Point(end_6.Start)
pt_7 = Point(end_6.End)
pdecon_2 = Deconstruct(Point=pt_6)  # -> XComponent, YComponent, ZComponent
pdecon_3 = Deconstruct(Point=pt_7)  # -> XComponent, YComponent, ZComponent
smaller_7 = SmallerThan(FirstNumber=pdecon_2.ZComponent, SecondNumber=pdecon_3.ZComponent)  # -> SmallerThan, OrEqualTo
dispatch_9 = Dispatch(List=relay, DispatchPattern=smaller_7.SmallerThan)  # -> ListA, ListB
flip_3 = FlipCurve(Curve=dispatch_9.ListB)  # -> Curve, Flag
crv_7 = Curve([dispatch_9.ListA, flip_3.Curve])

# ----
clean_2 = CleanTree(RemoveNulls=True, RemoveInvalid=True, RemoveEmpty="true", Tree=crv_7)
topoly = CurveToPolyline(Curve=clean_2, ToleranceDistance="2", ToleranceAngle=0)  # -> Polyline, Segments

# ---- group: Print specification
len_3 = Length(Curve=topoly.Polyline)
multiplication = Multiplication(A=len_3, B=Slider(50, range=0..100))
division_4 = Division(A=multiplication, B=Slider(1000000, range=0..1000000))
division_5 = Division(A=layer_height, B=Slider(1000, range=0..1000000))
division_6 = Division(A=len_3, B=Slider(200, range=0..200))
multiplication_2 = Multiplication(A=division_4, B=division_5)
multiplication_3 = Multiplication(A=multiplication_2, B=Slider(2100, range=0..10000))
division_7 = Division(A=division_6, B=Slider(60, range=0..100))
m3 = Panel(multiplication_2)
print_time_minutes = Panel(division_7)
weight_kg = Panel(multiplication_3)

# ----
explode = Explode(Curve=topoly.Polyline, Recursive=True)  # -> Segments, flatten(Vertices)

# ---- group: End point
item_10 = ListItem(List=explode.Vertices, Index="-1", Wrap=True)
number_slider_4 = Slider(200, range=0..1000)
pdecon_4 = Deconstruct(Point=item_10)  # -> XComponent, YComponent, ZComponent
addition = Addition(A=pdecon_4.ZComponent, B=Slider(100, range=0..1000))
addition_2 = Addition(A=number_slider_4, B=pdecon_4.XComponent)
addition_3 = Addition(A=number_slider_4, B=pdecon_4.YComponent)
subtraction = Subtraction(A=pdecon_4.YComponent, B=number_slider_4)
subtraction_2 = Subtraction(A=pdecon_4.XComponent, B=number_slider_4)
pt_8 = ConstructPoint(XCoordinate=subtraction_2, YCoordinate=subtraction, ZCoordinate=addition)
pt_9 = ConstructPoint(XCoordinate=addition_2, YCoordinate=subtraction, ZCoordinate=addition)
pt_10 = ConstructPoint(XCoordinate=subtraction_2, YCoordinate=addition_3, ZCoordinate=addition)
pt_11 = ConstructPoint(XCoordinate=addition_2, YCoordinate=addition_3, ZCoordinate=addition)
filter_5 = StreamFilter(Gate=end_point, Stream0=pt_11, Stream1=pt_9, Stream2=pt_10, Stream3=pt_8)

# ---- group: Start point
item_11 = ListItem(List=explode.Vertices, Index=0, Wrap=True)
pdecon_5 = Deconstruct(Point=item_11)  # -> XComponent, YComponent, ZComponent
addition_4 = Addition(A=pdecon_5.ZComponent, B=Slider(50, range=0..1000))
pt_12 = ConstructPoint(XCoordinate=pdecon_5.XComponent, YCoordinate=pdecon_5.YComponent, ZCoordinate=addition_4)

# ---- group: Plane orient
entwine = Entwine(Branch00=pt_12, Branch01=explode.Vertices, Branch02=filter_5, FlattenInputs=True)  # -> flatten(Result)
pdecon_6 = Deconstruct(Point=entwine)  # -> XComponent, YComponent, ZComponent
pt_13 = ConstructPoint(XCoordinate=0, YCoordinate=0, ZCoordinate=pdecon_6.ZComponent)
xy = XYPlane(Origin=entwine)
vec2pt = Vector2Pt(PointA=pt_13, PointB=entwine, Unitize=False)  # -> Vector, Length
X = UnitX(Factor=1)
orient = OrientDirection(Geometry=xy, PointA=xy, DirectionA=X, PointB=xy, DirectionB=vec2pt.Vector)  # -> flatten(Geometry), Transform

# ----
gate_4 = StreamGate(Stream=orient.Geometry, Gate=list_2)  # -> Target0, Target1
prot = RotatePlane(Plane=gate_4.Target0, Angle=degrees(Slider(180, range=0..1000)))

# ---- group: Trajectory simulation
data = Data(explode.Vertices)
lng_6 = ListLength(List=flatten(data))
concat_2 = Concatenate(FragmentA="0 to ", FragmentB=lng_6)
remap_5 = RemapNumbers(Value=number_slider, Source=Domain(0, 1), Target=concat_2)  # -> Mapped, Clipped
round_2 = Round(Number=remap_5.Mapped)  # -> Nearest, Floor, Ceiling
split_4 = SplitList(List=flatten(data), Index=round_2.Nearest)  # -> ListA, ListB
pline_2 = PolyLine(Vertices=flatten(split_4.ListA), Closed=False)

# ---- group: Ashish script
number_slider_5 = Slider(12, range=0..100)  # disabled
brep_4 = Brep()  # disabled
contour_4 = Contour(Shape=brep_4, Point=Point(0, 0, 0), Direction=Vector(0, 0, 1), Distance=number_slider_5)  # disabled
number_slider_6 = Slider(100, range=0..1000)  # disabled
number_slider_7 = Slider(30, range=0..100)  # disabled
number_slider_8 = Slider(30, range=0..100)  # disabled
neg_5 = Negative(Value=number_slider_8)  # disabled
number_slider_9 = Slider(1, range=0..1)  # disabled

# Open curves
crv_8 = Curve(contour_4)  # disabled
cls_3 = Closed(Curve=crv_8)  # -> Closed, Periodic; disabled
dispatch_10 = Dispatch(List=crv_8, DispatchPattern=cls_3.Closed)  # -> ListA, ListB; disabled
geo_7 = Geometry(dispatch_10.ListB)  # disabled
geo_8 = Geometry(dispatch_10.ListA)  # disabled
divide_4 = DivideCurve(Curve=geo_7, Count=number_slider_6, Kinks=False)  # -> Points, Tangents, Parameters; disabled
divide_5 = DivideCurve(Curve=geo_8, Count=number_slider_6, Kinks=False)  # -> Points, Tangents, Parameters; disabled
culln_3 = CullNth(List=divide_5.Points, CullFrequency=number_slider_6)  # disabled
panel_3 = Panel("{0,2,...}")  # disabled
split_5 = SplitTree(Data=simplify(divide_4.Points), Masks=flatten(panel_3))  # -> Positive, reverse(Negative); disabled
number_slider_10 = Slider(0, range=0..10)  # disabled
merge_4 = Merge(Data1=split_5.Positive, Data2=split_5.Negative)  # -> flatten(Result); disabled
intcrv_7 = Interpolate(Vertices=flatten(culln_3), Degree=3, Periodic=False, KnotStyle=1)  # -> Curve, Length, Domain; disabled
intcrv_8 = Interpolate(Vertices=merge_4, Degree=3, Periodic=False, KnotStyle=number_slider_10)  # -> Curve, Length, Domain; disabled
null = NullItem(Item=[intcrv_8.Curve, intcrv_7.Curve])  # -> NullFlags, InvalidFlags, Description; disabled
dispatch_11 = Dispatch(List=[intcrv_7.Curve, intcrv_8.Curve], DispatchPattern=null.NullFlags)  # -> ListA, ListB; disabled

divide_length_3 = DivideLength(Curve=dispatch_11.ListA, Length=number_slider_7)  # -> Points, Tangents, Parameters; disabled
horizontal_frame_3 = HorizontalFrame(Curve=dispatch_11.ListA, Parameter=divide_length_3.Parameters)  # disabled
deplane_7 = DeconstructPlane(Plane=simplify(horizontal_frame_3))  # -> Origin, XAxis, YAxis, ZAxis; disabled
line_6 = LineSDL(Start=divide_length_3.Points, Direction=deplane_7.YAxis, Length=neg_5)  # disabled
end_7 = EndPoints(Curve=line_6)  # -> Start, End; disabled
cull_pattern_5 = CullPattern(List=divide_length_3.Points, CullPattern=[False, True])  # disabled
cull_pattern_6 = CullPattern(List=end_7.End, CullPattern=invert([False, True]))  # disabled
shift_list_3 = ShiftList(List=cull_pattern_6, Shift=number_slider_9, Wrap=True)  # disabled
list_length_3 = ListLength(List=shift_list_3)  # disabled
cull_nth_3 = CullNth(List=shift_list_3, CullFrequency=list_length_3)  # disabled
weave_7 = Weave(Pattern=[0, 1], Stream0=cull_pattern_5, Stream1=cull_nth_3, NullGaps=False)  # disabled
polyline_3 = PolyLine(Vertices=weave_7, Closed=False)  # disabled
intcrv_9 = Interpolate(Vertices=weave_7, Degree=3, Periodic=False, KnotStyle=1)  # -> Curve, Length, Domain; disabled

# ---- group: Angle of nozzle
pln_8 = Plane([gate_4.Target1, prot])
deplane_8 = DeconstructPlane(Plane=pln_8)  # -> Origin, XAxis, YAxis, ZAxis
pdecon_7 = Deconstruct(Point=deplane_8.Origin)  # -> XComponent, YComponent, ZComponent
pt_14 = ConstructPoint(XCoordinate=0, YCoordinate=0, ZCoordinate=pdecon_7.ZComponent)
dist = Distance(PointA=deplane_8.Origin, PointB=pt_14)

# ---- group: Angle of nozzle / Min max angle
number_slider_11 = Slider(101, range=0..1000)

# ----
gate_5 = StreamGate(Stream=number_slider_11, Gate=list_2)  # -> Target0, Target1
neg_6 = Negative(Value=gate_5.Target0)

# ---- group: Angle of nozzle / Min max angle (continued)
dom_6 = ConstructDomain(DomainStart=Slider(0, range=0..1000), DomainEnd=[neg_6, gate_5.Target1])

# ---- group: Angle of nozzle (continued)
remap_6 = RemapNumbers(Value=dist, Source=dom_5, Target=dom_6)  # -> Mapped, Clipped
prot_2 = RotatePlane(Plane=pln_8, Angle=degrees(remap_6.Mapped))

# ----
target_3 = CreateTarget(Plane=prot_2, Motion=list_5, Tool=tool.Tool, Speed="400", Zone="15", IsCartesian=True)  # -> flatten(Target)
filter_6 = StreamFilter(Gate=program_calculations_takes_long_time_set, Stream1=target_3)
program = CreateProgram(Name="Jirka", RobotSystem=load_robot, Targets1=flatten(filter_6), StepSize=1)  # -> Program, Code, Duration, Warnings, Errors
sim = ProgramSimulation(Program=program.Program, Time=number_slider, Normalized=True)  # -> SystemMeshes, JointRotations, Plane, Index, Time, Program, Errors
lng_7 = ListLength(List=flatten(program.Code))

# ---- group: Print preview
decprogtarg = DeconstructProgramTargets(Program=program.Program)  # -> Planes, Joints, Configuration, DeltaTime
item_12 = ListItem(List=decprogtarg.Planes, Index="-1", Wrap=True)  # -> flatten(Item)
split_6 = SplitList(List=item_12, Index=sim.Index)  # -> ListA, ListB
pline_3 = PolyLine(Vertices=split_6.ListA, Closed=False)

# ----
panel_4 = Panel(program.Code)
panel_5 = Panel(program.Errors)
txt = Text(flatten(program.Code))
concat_3 = Concatenate(FragmentA=panel, FragmentB="_", FragmentC=objdet.Layer, FragmentD="_", FragmentE=lng_7)
python = GhPythonScript(program=txt, path="C:\Program1\", name=concat_3, write=export_code)  # -> out, a; inputs program: list
# ---------- python: Python ----------
__author__ = "kunal, edited by jirka"
__version__ = "2020.06.03"

import rhinoscriptsyntax as rs

if write:
    with open(path + name + '.prg', 'w') as file:
        for line in program:
            file.write(line)
            file.write('\n')
# ---------- end python ----------
